# Grasshopper definition fillet.gh (Grasshopper 1.0.7)

expression = Expression(x=Slider(22.5, range=0..100), Expression="x/2")
blend_angle = Data(expression)
total_angle = Number(Slider(180, range=0..1000))
arc_radius = Number(Slider(5, range=0..10))

multiplication = Multiplication(A=blend_angle, B=2)
subtraction = Subtraction(A=180, B=multiplication)
initial_line_segment = Curve(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)
subtraction_2 = Subtraction(A=multiplication, B=total_angle)
rad = Radians(Degrees=subtraction)
number_slider = Slider(0.6, range=0..1)
rad_2 = Radians(Degrees=subtraction_2)
rotate = Rotate(Geometry=initial_line_segment, Angle=rad, Plane=PlaneXY(0, 0, 0))  # -> Geometry, Transform
flip = FlipCurve(Curve=initial_line_segment)  # -> Curve, Flag
blendc = BlendCurve(CurveA=flip.Curve, CurveB=rotate.Geometry, BulgeA=number_slider, BulgeB=number_slider, Continuity=2)

curvature = Curvature(Curve=reparameterize(blendc), Parameter=0.5)  # -> P, K, C
unit = UnitVector(Vector=curvature.K)
vlen = VectorLength(Vector=curvature.K)
one_over_x = OneOverX(Value=vlen)
multiplication_2 = Multiplication(A=unit, B=one_over_x)
addition = Addition(A=curvature.P, B=multiplication_2)
center = Point(addition)
radius = Number(multiplication_2)
_1_radius = Number(vlen)

# ---- group: Blend End
subcrv = SubCurve(BaseCurve=reparameterize(blendc), Domain=Domain(0.5, 1))
xy = XYPlane(Origin=center)
rotate_2 = Rotate(Geometry=subcrv, Angle=rad_2, Plane=xy)  # -> Geometry, Transform

# ---- group: Blend Start
subcrv_2 = SubCurve(BaseCurve=reparameterize(blendc), Domain=Domain(0, 0.5))
end = EndPoints(Curve=subcrv_2)  # -> Start, End

# ----
neg = Negative(Value=rad_2)

# ---- group: Middle Arc
cen = Point(center)
middle_arc_start_pt = Point(end.End)
radius_2 = Number(radius)
middle_arc_angle = Number(neg)
subtraction_3 = Subtraction(A=middle_arc_start_pt, B=cen)
xprod = CrossProduct(VectorA=subtraction_3, VectorB=Vector(0, 0, 1), Unitize=False)  # -> Vector, Length
pl = ConstructPlane(Origin=cen, XAxis=subtraction_3, YAxis=xprod.Vector)
arc = Arc(Plane=pl, Radius=radius_2, Angle=middle_arc_angle)  # -> Arc, Length

# ----
pdecon = Deconstruct(Point=center)  # -> XComponent, YComponent, ZComponent
subtraction_4 = Subtraction(A=pdecon.YComponent, B=pdecon.XComponent)
X = UnitX(Factor=subtraction_4)
blend_start = Curve(subcrv_2)
blend_end = Curve(rotate_2.Geometry)
mid_arc = Curve(arc.Arc)
cen_2 = Point(center)

move = Move(Motion=X)  # -> Geometry, Transform
radius_3 = Number(arc_radius)
scale = Scale(Center=Point(0, 0, 0), Factor=_1_radius)  # -> Geometry, Transform
scale_2 = Scale(Center=Point(0, 0, 0), Factor=radius_3)  # -> Geometry, Transform
merge = Merge(Data1=move.Transform, Data2=scale.Transform, Data3=scale_2.Transform)
comp = Compound(Transforms=merge)

merge_2 = Merge(Data1=blend_start, Data2=mid_arc, Data3=blend_end)
transform = Transform(Geometry=merge_2, Transform=comp)
xz = XZPlane(Origin=Point(0, 0, 0))
crv = Curve(transform)
crvgraph = CurvatureGraph(Curve=crv, Density=5, Scale=105)
orient = Orient(Geometry=transform, Source=PlaneXY(0, 0, 0), Target=xz)  # -> Geometry, Transform
crv_2 = Curve(orient.Geometry)
