# Grasshopper definition keycaps.gh (Grasshopper 1.0.7)

# ----
# Example: 60%
panel = Panel("""1
1
1
1
1
1
1
1
1
1
1
1
1
1
1""")
panel_2 = Panel("""1.5
1
1
1
1
1
1
1
1
1
1
1
1
1.5""")
panel_3 = Panel("""1.75
1
1
1
1
1
1
1
1
1
1
1
2.25""")
panel_4 = Panel("""2.25
1
1
1
1
1
1
1
1
1
1
2.75""")
panel_5 = Panel("""1.5
1
1.5
6
1.5
1
1
1.5""")
path_mapper = PathMapper(panel_5, source="{A}", target="{0}")
path_mapper_2 = PathMapper(panel_4, source="{A}", target="{1}")
path_mapper_3 = PathMapper(panel_3, source="{A}", target="{2}")
path_mapper_4 = PathMapper(panel_2, source="{A}", target="{3}")
path_mapper_5 = PathMapper(panel, source="{A}", target="{4}")
merge = Merge(Data1=path_mapper, Data2=path_mapper_2, Data3=path_mapper_3, Data4=path_mapper_4, Data5=path_mapper_5)

data = Data(merge)
multiplication = Multiplication(A=data, B=19.05)
tstat = TreeStatistics(Tree=data)  # -> Paths, Length, Count
ins = InsertItems(List=multiplication, Item=0, Indices=0, Wrap=True)
ma = MassAddition(Input=ins)  # -> Result, PartialResults
cull_i = CullIndex(List=ma.PartialResults, Indices=-1, Wrap=True)
pt = ConstructPoint(XCoordinate=cull_i, YCoordinate=0, ZCoordinate=0)

# ----
# Example: Ergo
crv = Curve([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])
crv_2 = Curve([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])
crv_3 = Curve([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])
crv_4 = Curve([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])
crv_5 = Curve([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])
path_mapper_6 = PathMapper(crv, source="{A}", target="{0}")
path_mapper_7 = PathMapper(crv_2, source="{A}", target="{1}")
path_mapper_8 = PathMapper(crv_3, source="{A}", target="{2}")
path_mapper_9 = PathMapper(crv_4, source="{A}", target="{3}")
path_mapper_10 = PathMapper(crv_5, source="{A}", target="{4}")
merge_2 = Merge(Data1=path_mapper_6, Data2=path_mapper_7, Data3=path_mapper_8, Data4=path_mapper_9, Data5=path_mapper_10)

series = Series(Start=0, Step=19.05, Count=tstat.Count)
xy = XYPlane(Origin=pt)
Y = UnitY(Factor=series)
move = Move(Geometry=xy, Motion=graft(Y))  # -> Geometry, Transform
rectangle = Rectangle(Plane=move.Geometry, XSize=multiplication, YSize=Domain(0, 19.05), Radius=0)  # -> Rectangle, Length

# ----
# Profile Data
panel_6 = Panel("""R1,9.8,9.8
R2,7.8,7.3
R3,7.2,6.2
R4,8.6,6.2""")

# ----
# Profile for each branch
panel_7 = Panel("""R4
R4
R3
R2
R1""")

# ----
# Key Rects for each row
crv_6 = Curve(merge_2)

c_script = CSharpScript(x=crv_6)  # -> out, A; inputs x: Polyline
# ---------- c_script: C# ----------
A = x.GetSegments();
# ---------- end c_script ----------
split = TextSplit(Text=panel_6, Separators=",")
item = ListItem(List=c_script.A, Index=1, Wrap=True)
item_2 = ListItem(List=c_script.A, Index=0, Wrap=True)
item_3 = ListItem(List=split, Index=1, Wrap=True)  # -> flatten(Item)
item_4 = ListItem(List=split, Index=2, Wrap=True)  # -> flatten(Item)
item_5 = ListItem(List=split, Index=0, Wrap=True)  # -> flatten(Item)
end = EndPoints(Curve=item_2)  # -> Start, End
end_2 = EndPoints(Curve=item)  # -> Start, End
data_2 = Data(panel_7)
data_3 = Data(item_5)
data_4 = Data(item_3)
data_5 = Data(item_4)
subtraction = Subtraction(A=end.End, B=end.Start)
subtraction_2 = Subtraction(A=end_2.End, B=end_2.Start)
unit = UnitVector(Vector=subtraction)
vlen = VectorLength(Vector=subtraction)
unit_2 = UnitVector(Vector=subtraction_2)
vlen_2 = VectorLength(Vector=subtraction_2)
keysearch = KeyValueSearch(Keys=data_3, Values=data_4, Search=data_2)
keysearch_2 = KeyValueSearch(Keys=data_3, Values=data_5, Search=data_2)
pl = ConstructPlane(Origin=end.Start, XAxis=unit, YAxis=unit_2)
pshift = ShiftPaths(Data=vlen, Offset=-1)
pshift_2 = ShiftPaths(Data=vlen_2, Offset=-1)
pshift_3 = ShiftPaths(Data=pl, Offset=-1)

# ----
# Keycap Shape
number_slider = Slider(0.5, range=0..1)

key_base_plane = Plane(pshift_3)
y_size_mm = Data(pshift_2)
x_size_mm = Data(pshift)
data_6 = Data(graft(keysearch_2))
data_7 = Data(graft(keysearch))

# ----
# Size Label
key_base_plane_2 = Plane(key_base_plane)
x_size_mm_2 = Data(x_size_mm)
number_slider_2 = Slider(2, range=0..10)
division = Division(A=x_size_mm_2, B=19.05)
format = Format(Format="{0:#.00}", Culture=127, Data0=division)
larger = LargerThan(FirstNumber=division, SecondNumber=1.01)  # -> LargerThan, OrEqualTo
vec = VectorXYZ(XComponent=number_slider_2, YComponent=number_slider_2, ZComponent=0)  # -> Vector, Length
long = LongestList(ListA=format, PaddingMode=2)  # -> ListA, ListB
int = Integer(larger.LargerThan)
move_2 = Move(Geometry=key_base_plane_2, Motion=vec.Vector)  # -> Geometry, Transform
p_n_c = PickNChoose(Pattern=int, Stream0=long.ListB, Stream1=long.ListA)
tag = TextTag3D(Location=move_2.Geometry, Text=p_n_c, Size=Slider(4, range=0..10), Justification=7)

# ----
# Top Rect
y_size_mm_2 = Data(y_size_mm)
base_offset_mm = Data(number_slider)
x_offset_mm = Data(Slider(3, range=0..10))
y_upper_offset_mm = Data(Slider(0.5, range=0..1))
z_upper = Data(data_7)
z_lower = Data(data_6)
y_lower_offset_mm = Data(Slider(4, range=0..10))
x_size_mm_3 = Data(x_size_mm)
addition = Addition(A=base_offset_mm, B=x_offset_mm)
addition_2 = Addition(A=base_offset_mm, B=y_upper_offset_mm)
addition_3 = Addition(A=base_offset_mm, B=y_lower_offset_mm)
subtraction_3 = Subtraction(A=y_size_mm_2, B=addition_2)
subtraction_4 = Subtraction(A=x_size_mm_3, B=addition)
c_script_2 = CSharpScript(x0=addition, x1=subtraction_4, y0=addition_3, y1=subtraction_3, z0=z_upper, z1=z_lower)  # -> out, A; inputs x0: Double, x1: Double, y0: Double, y1: Double, z0: Double, z1: Double
# ---------- c_script_2: C# ----------
var pline = new Polyline();

pline.Add(x0, y0, z0);
pline.Add(x1, y0, z0);
pline.Add(x1, y1, z1);
pline.Add(x0, y1, z1);
pline.Add(x0, y0, z0);

A = pline;
# ---------- end c_script_2 ----------

number_slider_3 = Slider(0.4, range=0..1)  # disabled

# ----
# Bottom Rect
y_size_mm_3 = Data(y_size_mm)
base_offset_mm_2 = Data(Slider(0.5, range=0..1))
x_size_mm_4 = Data(x_size_mm)

subtraction_5 = Subtraction(A=x_size_mm_4, B=base_offset_mm_2)
subtraction_6 = Subtraction(A=y_size_mm_3, B=base_offset_mm_2)

c_script_3 = CSharpScript(x0=base_offset_mm_2, x1=subtraction_5, y0=base_offset_mm_2, y1=subtraction_6, z0=0, z1=0)  # -> out, A; inputs x0: Double, x1: Double, y0: Double, y1: Double, z0: Double, z1: Double; same code as c_script_2

# ----
# Construct Keycap Body
bottom_radius = Data(Slider(0.5, range=0..10))
top_radius = Data(Slider(1.5, range=0..10))
bottom_rect = Data(c_script_3.A)
top_rect = Data(c_script_2.A)
fillet = Fillet(Curve=bottom_rect, Radius=bottom_radius)
fillet_2 = Fillet(Curve=top_rect, Radius=top_radius)
explode = Explode(Curve=fillet, Recursive=True)  # -> Segments, Vertices
explode_2 = Explode(Curve=fillet_2, Recursive=True)  # -> Segments, Vertices
rulesrf = RuledSurface(CurveA=explode.Segments, CurveB=explode_2.Segments)
join = BrepJoin(Breps=rulesrf)  # -> Breps, Closed
cap = CapHoles(Brep=join.Breps)

# ----
# Top Face Cutter
top_rect_2 = Data(c_script_2.A)
Z = Data(Slider(0.5, range=0..1))
neg = Negative(Value=Z)
multiplication_2 = Multiplication(A=Z, B=2)
c_script_4 = CSharpScript(pl=top_rect_2, z=neg)  # -> out, A, B; inputs pl: Polyline, z: Double
# ---------- c_script_4: C# ----------
var segments = pl.GetSegments();
var plane = new Plane(segments[0].From, segments[0].To-segments[0].From, segments[1].To-segments[1].From);

Point3d midPoint = (Point3d)(segments[0].To - segments[0].From)*0.5;
midPoint.Transform(Transform.Translation(new Vector3d(0, 0, z)));

var arc = new Arc(
    Point3d.Origin,
    midPoint,
    (Point3d)(segments[0].To-segments[0].From)
);
arc.Transform(Transform.PlaneToPlane(Plane.WorldXY, plane));

A = arc;
B = plane;
# ---------- end c_script_4 ----------
bbox = BoundingBox(Content=graft(top_rect_2), Plane=graft(c_script_4.B), UnionBox=True)  # -> Box, Box_2
deplane = DeconstructPlane(Plane=c_script_4.B)  # -> Origin, XAxis, YAxis, ZAxis
multiplication_3 = Multiplication(A=deplane.ZAxis, B=multiplication_2)

pshift_4 = ShiftPaths(Data=bbox.Box, Offset=-1)

debox = DeconstructBox(Box=pshift_4)  # -> Plane, X, Y, Z
dedomain = DeconstructDomain(Domain=debox.Y)  # -> Start, End
subtraction_7 = Subtraction(A=dedomain.End, B=dedomain.Start)
multiplication_4 = Multiplication(A=deplane.YAxis, B=subtraction_7)
move_3 = Move(Geometry=c_script_4.A, Motion=expr("x*-0.5", multiplication_4))  # -> Geometry, Transform
multiplication_5 = Multiplication(A=multiplication_4, B=2)
extr = Extrude(Base=move_3.Geometry, Direction=multiplication_5)
extr_2 = Extrude(Base=extr, Direction=multiplication_3)  # -> graft(Extrusion)

sdiff = SolidDifference(BrepsA=cap, BrepsB=extr_2)
c_script_5 = CSharpScript(brep=sdiff)  # -> out, A; inputs brep: Brep; disabled
# ---------- c_script_5: C# ----------
double epsilon = 0.01;
A = brep.Edges.Select(x => x.GetBoundingBox(true).Min.Z > epsilon);
# ---------- end c_script_5 ----------
lng = ListLength(List=c_script_5.A)  # disabled
series_2 = Series(Start=0, Step=1, Count=lng)  # disabled
cull = CullPattern(List=series_2, CullPattern=c_script_5.A)  # disabled

orient = Orient(Geometry=sdiff, Source=PlaneXY(0, 0, 0), Target=graft(key_base_plane))  # -> Geometry, Transform
material = CreateMaterial(
    Diffuse=ColourSwatch(SwatchColor=RGB(143, 149, 178)),
    Specular=ColourSwatch(SwatchColor=RGB(153, 115, 38)),
    Emission=ColourSwatch(SwatchColor=RGB(0, 0, 0)),
    Transparency=Slider(0.25, range=0..1),
    Shine=Slider(5, range=0..100))
preview = CustomPreview(Geometry=orient.Geometry, Material=material)

filedge = FilletEdge(Shape=sdiff, Blend=0, Metric=0, Edges=cull, Radii=number_slider_3)  # disabled
